# Grasshopper definition AddSurfaceArea.gh (Grasshopper 1.0.7)
# plug-ins: RhinoCityJSON

# ---- group: Adjust to file!
toggle = BooleanToggle(False)
path = FilePath()
pt = Point(Point(0, 0, 0))
panel = Panel("50")
panel_2 = Panel("1.3")

# ----
rsettings = SettingsReader(Translate=toggle, ModelOrigin=pt, TrueNorth=panel, LoD=panel_2, LargeFiles=False)
oreader = ReaderObjects(Path=path, Activate=Toggle(False), Settings=rsettings)  # -> Geometry, SurfaceInformation, ObjectInformation

# ---- group: Adding the area to the surface data
area = Area(Geometry=oreader.Geometry)  # -> simplify(graft(Area)), Centroid
add = AttributeAdd(InformationObjects=oreader.SurfaceInformation, AttributeName="Surface Area", AttributeValue=area.Area)

# ----
imanage = InformationManager(Geometry=oreader.Geometry, SurfaceInfo=add, ObjectInfo=oreader.ObjectInformation)  # -> Geometry, MergedSurfaceInformation
baking = Bakery(Geometry=imanage.Geometry, MergedSurfaceInfo=imanage.MergedSurfaceInformation, Activate=Button())
