# Grasshopper definition IsolateRoofSurfaces.gh (Grasshopper 1.0.7)
# plug-ins: RhinoCityJSON

# ---- group: Adjust to file!
toggle = BooleanToggle(False)
path = FilePath()
pt = Point(Point(0, 0, 0))
panel = Panel("50")
panel_2 = Panel("1.3")

# ----
rsettings = SettingsReader(Translate=toggle, ModelOrigin=pt, TrueNorth=panel, LoD=panel_2, LargeFiles=False)
oreader = ReaderObjects(Path=path, Activate=Toggle(False), Settings=rsettings)  # -> Geometry, SurfaceInformation, ObjectInformation

# ---- group: Based on the surface keys/value the surface type can be isolated
surface_filter = SurfaceKeys({"Object Name", "Geometry Type", "Geometry Name", "Geometry LoD", "Surface Material", "Surface type", "Surface on_footprint_edge"}, selected="Surface type")
filter = AttributeFilter(InformationObjects=oreader.SurfaceInformation, FilterKey=surface_filter, FilterValue="RoofSurface")

# ---- group: IManage resolves the geometry filtering
imanage = InformationManager(Geometry=oreader.Geometry, SurfaceInfoKeys=filter, SurfaceInfoValues=oreader.ObjectInformation)  # -> Geometry, MergedSurfaceInfoKeys
preview = CustomPreview(Geometry=imanage.Geometry, Material=ColourSwatch(SwatchColor=RGB(255, 255, 0)))
